% Simulink data dictionary bus_types_binary.sldd

btAlias = Simulink.AliasType(BaseType="uint8")  % alias of uint8

btBus = Simulink.Bus()  % four elements, four cases
  plain: double
  aliased: btAlias
  geared: Enum: GearMode
  matrix: double[2 3], Complexity="complex"

btEnumDef = enum(DefaultValue="OFF", StorageType="int32")  % a dictionary-defined enum
  OFF = 0  % off state
  ON = 1  % on state

btNumeric = Simulink.NumericType(DataTypeMode="Fixed-point: binary point scaling", SignednessBool=true, WordLength=16, FixedExponent=-3)  % fixdt(1,16,3)
btValueType = Simulink.ValueType(DataType="btAlias", Dimensions=[1 4], be=Simulink.BusElement(Name="a", DataType="double"))  % a value type over an alias