% Simulink data dictionary cell1x1_binary.sldd

c0 = []
c11 = {1}
c11cell = {{2}}
c11char = {"ab"}
c11empty = {[]}
c11obj = {struct(Simulink.Parameter(Value=3))}
c11str = {struct("a")}
c12 = {1, 2}
c21 = {1; 2}
cNest = {1, {2, {3}}}
cOfS = {struct(c={6})}
s11 = struct(c={4})
sArr = [struct(c={7}), struct(c={8})]
sNest = struct(a=1, c={{5}})

widget = Widget(
  Scalar=0,
  Matrix=0,
  Cplx=0,
  Padded=0,
  Str=0,
  Flag=0,
  Nothing=0,
  EmptyStruct=0,
  ZeroStruct=0,
  Nested=struct(c={10}),
  Cells={9},
  Hostile=0,
  Ctrl=0,
  Cr=0,
  Tab=0,
  Lf=0,
  Mode=0,
  Part=0,
  Parts=0,
  Tuning=0)