% Simulink data dictionary cellarr_binary.sldd

cCplx = {1.0+2.0i}
cCplxArr = {[1.0+2.0i 3.0-4.0i]}
cCplxCol = {[1.0+2.0i; 3.0-4.0i]}
cCplxNd = {reshape([1.0+1.0i 2.0+2.0i 3.0+3.0i 4.0+4.0i 5.0+5.0i 6.0+6.0i 7.0+7.0i 8.0+8.0i], 2, 2, 2)}
cNd = {reshape([1 2 3 4 5 6 7 8 9 10 11 12], 2, 3, 2)}
cObj = {struct(Simulink.Parameter(Value=5))}
cObjArr = {struct(Simulink.Parameter(Value=1), Simulink.Parameter(Value=2))}
cStr = {struct("a")}
cStruct = {struct(a=1)}
cStructArr = {[struct(a=1), struct(a=2)]}
cStructArr2D = {[struct(a=1), struct(a=3), struct(a=2), struct(a=4)]}
pCplxArr = Simulink.Parameter([1.0+2.0i 3.0-4.0i], Complexity="complex")
sObjArr = struct(f=[Simulink.Parameter(Value=1), Simulink.Parameter(Value=2)])
sStructArr = struct(f=[struct(a=1), struct(a=2)])