% Simulink data dictionary char_empty_binary.sldd

c0x0 = []
c0x2 = []
c1x0 = []
c1x0x2 = []
c2x0 = [""; ""]
cell_c0x0 = {[]}
cell_c0x2 = {[]}
cell_c1x0 = {[]}
cell_c1x0x2 = {[]}
cell_c2x0 = {[""; ""]}
field_c0x0 = struct(f="")
field_c0x2 = struct(f="")
field_c1x0 = struct(f="")
field_c1x0x2 = struct(f="")
field_c2x0 = struct(f=[""; ""])