% Simulink data dictionary classes_r2027a_binary.sldd

bpD = Simulink.Breakpoint(
  Breakpoints=Simulink.lookuptable.Breakpoint(TunableSizeName="N", TunableSizeValue=-1, Dimensions=[0 0], FieldName="BP"))

busAl8 = Simulink.Bus()

lutD = Simulink.LookupTable(
  Table=Simulink.lookuptable.Table(Dimensions=[0 0], FieldName="Table"),
  BreakpointsSpecification="Explicit values",
  Breakpoints=Simulink.lookuptable.Breakpoint(TunableSizeName="N1", TunableSizeValue=-1, Dimensions=[0 0], FieldName="BP1"),
  AllowMultipleInstancesOfTypeToHaveDifferentTableBreakpointSizes=false)

pAl8 = Simulink.Parameter(1, StorageClass="ExportedGlobal")
pAlM1 = Simulink.Parameter(1, StorageClass="ExportedGlobal")
pNo = Simulink.Parameter(1)
pSC = Simulink.Parameter(1, StorageClass="ExportedGlobal")
sAl16 = Simulink.Signal(StorageClass="ExportedGlobal")
sigA = Simulink.Signal()
sigC = Simulink.Signal(DimensionsMode="Variable", Complexity="complex")
sigNo = Simulink.Signal()
sigR = Simulink.Signal()

vbD = Simulink.VariantBank(
  struct(
    Name="",
    Description="",
    VariantConditions=[],
    AllChoicesCoderInfo="",
    ActiveChoiceCoderInfo="",
    BankCoderInfo=""))

vbciD = Simulink.VariantBankCoderInfo(
  struct(HeaderFile="", DefinitionFile="", PreStatement="", PostStatement="", Qualifier="None"))