% Simulink data dictionary coder_info_binary.sldd

pNew = Simulink.Parameter(3, StorageClass="ExportedGlobal", Alias="pNewId")  % a Parameter made in the base workspace
pWs = Simulink.Parameter(2.5, Min=0, Max=10, Unit="m")  % a Parameter from a model workspace