% Simulink data dictionary custom_object_binary.sldd

gearRow = [GearMode.Park, GearMode.Drive, GearMode.Reverse]
gearValue = GearMode.Reverse

partCell = {struct(WidgetPart(PartId=101, Label="cell1")), struct(WidgetPart(PartId=103, Label="cell3"))
 struct(WidgetPart(PartId=102, Label="cell2")), struct(WidgetPart(PartId=104, Label="cell4"))}

widget = Widget(
  Scalar=1.5,
  Matrix=[1 2 3; 4 5 6],
  Cplx=3.0+4.0i,
  Padded="  pad me  ",
  Str="a string",
  Flag=true,
  Nested=struct(inner=struct(leaf=7)),
  Cells={1, "two", true},
  Hostile="amp & lt < gt > quot \" apos ' end",
  Ctrl="9 10 13 7 1",
  Cr="a\rb",
  Tab="a\tb",
  Lf="a\nb",
  Mode=GearMode.Reverse,
  Part=WidgetPart(PartId=1, Label="lead"),
  Parts=[WidgetPart(PartId=10, Label="part1"), WidgetPart(PartId=20, Label="part2"), WidgetPart(PartId=30, Label="part3")],
  Tuning=Simulink.Parameter(Description="nested MathWorks object", Value=2.5, DataType="single"))