% Simulink data dictionary derived_class_binary.sldd

dpGain = dexdata.DerivedParam(
  CalibLevel=42,
  CalibTag="high",
  IsLocked=true,
  Limits=struct(lo=-1, hi=9),
  Aliases={"alpha", "beta", "gamma"},
  Mode=GearMode.Reverse,
  Value=int32(7),
  DataType="int32",
  Min=-10,
  Max=100,
  Unit="m/s")  % a derived parameter

dpPlain = dexdata.DerivedParam(
  CalibLevel=3,
  CalibTag="cal",
  IsLocked=false,
  Limits=struct(lo=0, hi=1),
  Aliases={"a", "b"},
  Mode=GearMode.Drive,
  Dimensions=[0 0])

dsFlow = dexdata.DerivedSignal(Routing="external", Priority=int32(9), DataType="single", Min=-5, Max=5, Unit="V")  % a derived signal