% Simulink data dictionary dispcat_bin.sldd

dx_cell_0x0 = []
dx_cell_0x3 = []
dx_cell_1x0 = []
dx_char_0x0 = []
dx_char_0x2 = []
dx_char_1x0 = []
dx_complex_0x0 = []
dx_complex_1x0 = []
dx_complex_int16 = int16(1+2i)
dx_complex_int16_1x0 = []
dx_complex_scalar = 1.0+2.0i
dx_complex_vector = [1.0+2.0i 3.0-4.0i]
dx_double_0x0 = []
dx_double_0x0x2 = []
dx_double_0x1 = []
dx_double_0x3 = []
dx_double_1x0 = []
dx_enum_0x0 = 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
dx_enum_1x0 = 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
dx_int8_0x3 = []
dx_logical_1x0 = []
dx_param_complex_1x0 = Simulink.Parameter([])
dx_param_empty = Simulink.Parameter([])
dx_single_0x0 = []
dx_sparse_0x0 = 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
dx_sparse_2x0 = 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
dx_string_0x0 = []
dx_string_1x0 = []
dx_string_empty_1x1 = []
dx_struct_0x0 = []
dx_struct_0x0_fields = []
dx_struct_1x0 = []
e_logical_0x0 = []
e_logical_0x3 = []
e_single_complex_1x0 = []
e_sparse_logical_0x0 = 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
e_uint64_0x0 = []
en_i32_empty = []
en_i32_high = DispLevel.High
en_i32_vec = [DispLevel.Low, DispLevel.High]
en_off = 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
en_on = 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
en_onoff_vec = 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
en_sl_empty = []
en_sl_red = DispColor.Red
en_sl_vec = [DispColor.Red, DispColor.Blue]

enumdef = enum()
  enum1 = 0
  Second = 2

fi_vec = fi([1 2 3], 1, 16, 8)
p_enum = Simulink.Parameter(DispColor.Green, DataType="Enum: DispColor")
sp_complex = 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
sp_complex_scalar = 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
sp_logical = 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
sp_logical_scalar = true
sp_scalar = 5
sp_vec = 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
str_0x3 = []
z_int16 = int16(1+2i)
z_int16_vec = int16([1+2i 3-4i])
z_int8_vec = int8([1+2i -3-4i])
z_scalar = 1.0+2.0i
z_single = single(1.0+2.0i)
z_uint8 = uint8(3+4i)
z_vector = [1.0+2.0i 3.0-4.0i]
cat_ab = categorical(categoryNames={"a"; "b"}, codes=uint8([1 2]), isProtected=false, isOrdinal=false)

tbl_2x2 = table(
  data={[1; 2], {"a"; "b"}},
  ndims=2,
  nrows=2,
  nvars=2,
  varnames={"Var1", "Var2"},
  props=struct(
    CustomProps=[],
    VariableCustomProps=[],
    versionSavedFrom=5,
    minCompatibleVersion=1,
    incompatibilityMsg="",
    VersionSavedFrom=5,
    useVariableNamesOriginal=false,
    useVariableNames2048=false,
    useDimensionNamesOriginal=false,
    useDimensionNames2048=false,
    Description="",
    VariableNamesOriginal=[],
    VariableNames2048=[],
    DimensionNames={"Row", "Variables"},
    DimensionNamesOriginal=[],
    DimensionNames2048=[],
    UserData=[],
    VariableDescriptions=[],
    VariableUnits=[],
    VariableContinuity=[]))