% Simulink data dictionary values_binary.sldd

dScalar = 3.5
dRow = [1 2 3]
d2x3 = [1 2 3; 4 5 6]
dNegZero = -0
dInf = Inf
dNaN = NaN
dNonFinite = [Inf -Inf NaN]
zScalar = 1.0+2.0i
zArray = [1.0+2.0i 3.0-4.0i]
zZeroImag = 1.0+0.0i
zInt8 = int8(1-2i)
i8 = int8(-8)
i16 = int16(-16)
i32 = int32(-32)
i64 = int64(-9007199254740993)
i64Max = int64(9223372036854775807)
u8 = uint8(8)
u16 = uint16(16)
u32 = uint32(32)
u64 = uint64(9007199254740993)
u64Max = uint64(18446744073709551615)
sgl = single(1.5)
sglRow = single([0.1 -2.5])
lScalar = true
lArray = [true false true]
chRow = "hello"
chEmpty = []
ch2Row = ["ab"; "cd"]
strScalar = "text"
strEmpty = []
strRow = "a", "b"

str2x2 = "a", "b"
 "c", "d"

dEmpty0x3 = []
i8Empty1x0 = []
cEmpty = []
sNoFields = []
sEmpty0x0 = []
nd2x2x2 = reshape([1 2 3 4 5 6 7 8], 2, 2, 2)
spMatrix = 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
enumOn = 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

sLeaves = struct(
  dScalar=3.5,
  dRow=[1 2 3],
  d2x3=[1 2 3; 4 5 6],
  dNegZero=-0,
  dInf=Inf,
  dNaN=NaN,
  dNonFinite=[Inf -Inf NaN],
  zScalar=1.0+2.0i,
  zArray=[1.0+2.0i 3.0-4.0i],
  zZeroImag=1.0+0.0i,
  zInt8=int8(1-2i),
  i8=int8(-8),
  i16=int16(-16),
  i32=int32(-32),
  i64=int64(-9007199254740993),
  i64Max=int64(9223372036854775807),
  u8=uint8(8),
  u16=uint16(16),
  u32=uint32(32),
  u64=uint64(9007199254740993),
  u64Max=uint64(18446744073709551615),
  sgl=single(1.5),
  sglRow=single([0.1 -2.5]),
  lScalar=true,
  lArray=[true false true],
  chRow="hello",
  chEmpty="",
  ch2Row=["ab"; "cd"],
  strScalar="text",
  strEmpty=[],
  strRow="a", "b",
  str2x2="a", "b"
   "c", "d",
  dEmpty0x3=[],
  i8Empty1x0=[],
  cEmpty=[],
  sNoFields=[],
  sEmpty0x0=[],
  nd2x2x2=reshape([1 2 3 4 5 6 7 8], 2, 2, 2))

sArr = [struct(a=1, b="x"), struct(a=2, b="y"), struct(a=3, b=int8(3))]

cLeaves = {3.5, [1 2 3], [1 2 3; 4 5 6], -0, Inf, NaN, [Inf -Inf NaN], 1.0+2.0i, [1.0+2.0i 3.0-4.0i], 1.0+0.0i, int8(1-2i), int8(-8), int16(-16), int32(-32), int64(-9007199254740993), int64(9223372036854775807), uint8(8), uint16(16), uint32(32), uint64(9007199254740993), uint64(18446744073709551615), single(1.5), single([0.1 -2.5]), true, [true false true], "hello", [], ["ab"; "cd"], struct("text"), struct([]), struct("a", "b"), struct(
  "a", "b"
   "c", "d"), [], [], [], [], [], reshape([1 2 3 4 5 6 7 8], 2, 2, 2)}

c2x2 = {1, "a"
 struct("b"), int8(2)}

sNest = struct(c={1, struct(s=struct(f=7))})
cNest = {{1, {3, struct("s")}}}
saCell = [struct(c={1, "a"}), struct(c={struct(x=2)})]
deep4 = struct(a=struct(b={struct(c=struct(d=4))}))
spMatrixInStruct = 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
spMatrixInCell = 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
enumOnInStruct = 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
enumOnInCell = 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
pStruct = Simulink.Parameter(struct(a=1, b=int8([1 2]), inner=struct(x=2, y=[1 2 3])))
pStructArr = Simulink.Parameter([struct(a=1), struct(a=2)], DataType="struct")
pInt8 = Simulink.Parameter(int8([1 2 3]))
pComplex = Simulink.Parameter([1.0+2.0i 3.0-4.0i], Complexity="complex")
pMatrix = Simulink.Parameter([1 2; 3 4])
pProps = Simulink.Parameter(5, DataType="single", Min=0, Max=10, Unit="m")  % distance to the wall
sig = Simulink.Signal(DataType="int16", Min=-5, Max=5, Dimensions=[1 3], InitialValue="0")  % a signal
sHoldsParam = struct(p=Simulink.Parameter(Value=2), n=1)
cHoldsParam = {struct(Simulink.Parameter(Value=3)), "x"}

bus = Simulink.Bus()
  e1: double[1 2]
  e2: int8

numType = Simulink.NumericType(DataTypeMode="Fixed-point: binary point scaling", SignednessBool=true, WordLength=16, FixedExponent=-4)