% Simulink data dictionary lossy_empties_readback_binary.sldd

c_Ch002 = {[]}
c_ChWide = {[]}
c_D022 = {[]}
c_DWide = {[]}
c_En022 = {[]}
c_EnND = {struct(GearMode.Drive, GearMode.Drive, GearMode.Drive, GearMode.Drive)}
c_EnWide = {[]}
c_I8203 = {[]}
c_I8Wide = {[]}
c_Lg012 = {[]}
c_LgWide = {[]}
c_Str00 = {struct([])}
c_Str03 = {struct([])}
c_Str10 = {struct([])}
e_Ch002 = []
e_ChWide = []
e_D022 = []
e_DWide = []
e_En022 = []
e_EnND = [GearMode.Drive, GearMode.Drive, GearMode.Drive, GearMode.Drive]
e_EnWide = []
e_I8203 = []
e_I8Wide = []
e_Lg012 = []
e_LgWide = []
e_Str00 = []
e_Str03 = []
e_Str10 = []
p_Ch002 = Simulink.Parameter([], DataType="string")
p_ChWide = Simulink.Parameter([], DataType="string")
p_D022 = Simulink.Parameter([])
p_En022 = Simulink.Parameter([], DataType="Enum: GearMode")
p_EnND = Simulink.Parameter([GearMode.Drive, GearMode.Drive, GearMode.Drive, GearMode.Drive], DataType="Enum: GearMode")
p_I8203 = Simulink.Parameter([], DataType="int8")
p_Lg012 = Simulink.Parameter([], DataType="boolean")
s_Ch002 = struct(f="")
s_ChWide = struct(f="")
s_D022 = struct(f=[])
s_DWide = struct(f=[])
s_En022 = struct(f=[])
s_EnND = struct(f=[GearMode.Drive, GearMode.Drive, GearMode.Drive, GearMode.Drive])
s_EnWide = struct(f=[])
s_I8203 = struct(f=[])
s_I8Wide = struct(f=[])
s_Lg012 = struct(f=[])
s_LgWide = struct(f=[])
s_Str00 = struct(f=[])
s_Str03 = struct(f=[])
s_Str10 = struct(f=[])

w_Ch002 = Widget(
  Matrix=0,
  Cplx=0,
  Padded=0,
  Str=0,
  Flag=0,
  Nothing=0,
  EmptyStruct=0,
  ZeroStruct=0,
  Nested=0,
  Cells=0,
  Hostile=0,
  Ctrl=0,
  Cr=0,
  Tab=0,
  Lf=0,
  Mode=0,
  Part=0,
  Parts=0,
  Tuning=0)

w_ChWide = Widget(
  Matrix=0,
  Cplx=0,
  Padded=0,
  Str=0,
  Flag=0,
  Nothing=0,
  EmptyStruct=0,
  ZeroStruct=0,
  Nested=0,
  Cells=0,
  Hostile=0,
  Ctrl=0,
  Cr=0,
  Tab=0,
  Lf=0,
  Mode=0,
  Part=0,
  Parts=0,
  Tuning=0)

w_D022 = Widget(
  Matrix=0,
  Cplx=0,
  Padded=0,
  Str=0,
  Flag=0,
  Nothing=0,
  EmptyStruct=0,
  ZeroStruct=0,
  Nested=0,
  Cells=0,
  Hostile=0,
  Ctrl=0,
  Cr=0,
  Tab=0,
  Lf=0,
  Mode=0,
  Part=0,
  Parts=0,
  Tuning=0)

w_DWide = Widget(
  Matrix=0,
  Cplx=0,
  Padded=0,
  Str=0,
  Flag=0,
  Nothing=0,
  EmptyStruct=0,
  ZeroStruct=0,
  Nested=0,
  Cells=0,
  Hostile=0,
  Ctrl=0,
  Cr=0,
  Tab=0,
  Lf=0,
  Mode=0,
  Part=0,
  Parts=0,
  Tuning=0)

w_En022 = Widget(
  Matrix=0,
  Cplx=0,
  Padded=0,
  Str=0,
  Flag=0,
  Nothing=0,
  EmptyStruct=0,
  ZeroStruct=0,
  Nested=0,
  Cells=0,
  Hostile=0,
  Ctrl=0,
  Cr=0,
  Tab=0,
  Lf=0,
  Mode=0,
  Part=0,
  Parts=0,
  Tuning=0)

w_EnND = Widget(
  Scalar=[GearMode.Drive, GearMode.Drive, GearMode.Drive, GearMode.Drive],
  Matrix=0,
  Cplx=0,
  Padded=0,
  Str=0,
  Flag=0,
  Nothing=0,
  EmptyStruct=0,
  ZeroStruct=0,
  Nested=0,
  Cells=0,
  Hostile=0,
  Ctrl=0,
  Cr=0,
  Tab=0,
  Lf=0,
  Mode=0,
  Part=0,
  Parts=0,
  Tuning=0)

w_EnWide = Widget(
  Matrix=0,
  Cplx=0,
  Padded=0,
  Str=0,
  Flag=0,
  Nothing=0,
  EmptyStruct=0,
  ZeroStruct=0,
  Nested=0,
  Cells=0,
  Hostile=0,
  Ctrl=0,
  Cr=0,
  Tab=0,
  Lf=0,
  Mode=0,
  Part=0,
  Parts=0,
  Tuning=0)

w_I8203 = Widget(
  Matrix=0,
  Cplx=0,
  Padded=0,
  Str=0,
  Flag=0,
  Nothing=0,
  EmptyStruct=0,
  ZeroStruct=0,
  Nested=0,
  Cells=0,
  Hostile=0,
  Ctrl=0,
  Cr=0,
  Tab=0,
  Lf=0,
  Mode=0,
  Part=0,
  Parts=0,
  Tuning=0)

w_I8Wide = Widget(
  Matrix=0,
  Cplx=0,
  Padded=0,
  Str=0,
  Flag=0,
  Nothing=0,
  EmptyStruct=0,
  ZeroStruct=0,
  Nested=0,
  Cells=0,
  Hostile=0,
  Ctrl=0,
  Cr=0,
  Tab=0,
  Lf=0,
  Mode=0,
  Part=0,
  Parts=0,
  Tuning=0)

w_Lg012 = Widget(
  Matrix=0,
  Cplx=0,
  Padded=0,
  Str=0,
  Flag=0,
  Nothing=0,
  EmptyStruct=0,
  ZeroStruct=0,
  Nested=0,
  Cells=0,
  Hostile=0,
  Ctrl=0,
  Cr=0,
  Tab=0,
  Lf=0,
  Mode=0,
  Part=0,
  Parts=0,
  Tuning=0)

w_LgWide = Widget(
  Matrix=0,
  Cplx=0,
  Padded=0,
  Str=0,
  Flag=0,
  Nothing=0,
  EmptyStruct=0,
  ZeroStruct=0,
  Nested=0,
  Cells=0,
  Hostile=0,
  Ctrl=0,
  Cr=0,
  Tab=0,
  Lf=0,
  Mode=0,
  Part=0,
  Parts=0,
  Tuning=0)

w_Str00 = Widget(
  Matrix=0,
  Cplx=0,
  Padded=0,
  Str=0,
  Flag=0,
  Nothing=0,
  EmptyStruct=0,
  ZeroStruct=0,
  Nested=0,
  Cells=0,
  Hostile=0,
  Ctrl=0,
  Cr=0,
  Tab=0,
  Lf=0,
  Mode=0,
  Part=0,
  Parts=0,
  Tuning=0)

w_Str03 = Widget(
  Matrix=0,
  Cplx=0,
  Padded=0,
  Str=0,
  Flag=0,
  Nothing=0,
  EmptyStruct=0,
  ZeroStruct=0,
  Nested=0,
  Cells=0,
  Hostile=0,
  Ctrl=0,
  Cr=0,
  Tab=0,
  Lf=0,
  Mode=0,
  Part=0,
  Parts=0,
  Tuning=0)

w_Str10 = Widget(
  Matrix=0,
  Cplx=0,
  Padded=0,
  Str=0,
  Flag=0,
  Nothing=0,
  EmptyStruct=0,
  ZeroStruct=0,
  Nested=0,
  Cells=0,
  Hostile=0,
  Ctrl=0,
  Cr=0,
  Tab=0,
  Lf=0,
  Mode=0,
  Part=0,
  Parts=0,
  Tuning=0)