% Simulink data dictionary complex_binary.sldd

c = {struct(Simulink.Parameter(Value=9.0+10.0i, Complexity="complex")), struct(Simulink.Parameter(Value=[0.5+1.5i; 2.5-3.5i], Complexity="complex", Dimensions=[2 1]))}
c1Top = Simulink.Parameter(9.0+10.0i, Complexity="complex")
c2Top = Simulink.Parameter([0.5+1.5i; 2.5-3.5i], Complexity="complex")

lut = Simulink.LookupTable(
  Table=Simulink.lookuptable.Table(Value=[1.0+2.0i 3.0+4.0i 5.0+6.0i], Dimensions=[1 3], FieldName="Table"),
  BreakpointsSpecification="Explicit values",
  Breakpoints=Simulink.lookuptable.Breakpoint(
    Value=[1 2 3],
    TunableSizeName="N1",
    TunableSizeValue=-1,
    Dimensions=[1 3],
    FieldName="BP1"),
  AllowMultipleInstancesOfTypeToHaveDifferentTableBreakpointSizes=false)

mptP = mpt.Parameter(6.0-7.0i, Complexity="complex", StorageClass="Global", PersistenceLevel=int32(1))
pCol = Simulink.Parameter([1.0+2.0i; 3.0+4.0i; 5.0+6.0i], Complexity="complex")
pFrac = Simulink.Parameter(1.5+0.25i, Complexity="complex")
pInt16Row = Simulink.Parameter(int16([1+2i 3-4i 5+6i]), Complexity="complex")
pInt64 = Simulink.Parameter(int64(9223372036854775807+1i), Complexity="complex")
pInt8 = Simulink.Parameter(int8(3-4i), Complexity="complex")
pMat = Simulink.Parameter([1.0+2.0i 3.0+4.0i; 5.0+6.0i 7.0+8.0i], Complexity="complex")
pMixedNF = Simulink.Parameter([1.0+2.0i NaN+0.0i 3.0-4.0i], Complexity="complex")
pNd = Simulink.Parameter(reshape([1.0+8.0i 2.0+7.0i 3.0+6.0i 4.0+5.0i 5.0+4.0i 6.0+3.0i 7.0+2.0i 8.0+1.0i], 2, 2, 2), Complexity="complex")
pNegIm = Simulink.Parameter(1.0-2.0i, Complexity="complex")
pNonFinite = Simulink.Parameter([Inf-Infi NaN+1.0i 1.0NaNi -Inf+2.0i], Complexity="complex")
pRow = Simulink.Parameter([1.0+2.0i 3.0+4.0i 5.0+6.0i], Complexity="complex")
pScalar = Simulink.Parameter(3.0+4.0i, Complexity="complex")
pSingle = Simulink.Parameter(single(2.5-0.5i), Complexity="complex")
pSingleCol = Simulink.Parameter(single([0.5+1.5i; 2.5-3.5i]), Complexity="complex")
pStruct = Simulink.Parameter(struct(a=1.0+2.0i, b=[3.0+4.0i 5.0-6.0i]))
pThird = Simulink.Parameter(0.33333333333333331+0.1i, Complexity="complex")
pZeroIm = Simulink.Parameter(1.0+0.0i, Complexity="complex")
pZeroRe = Simulink.Parameter(0.0+5.0i, Complexity="complex")

s = struct(
  p=Simulink.Parameter(Value=7.0+8.0i, Complexity="complex"),
  v=Simulink.Parameter(Value=[1.0-1.0i 2.0-2.0i 3.0-3.0i], Complexity="complex", Dimensions=[1 3]),
  z=2.0+3.0i)

spTop = Simulink.Parameter(7.0+8.0i, Complexity="complex")
svTop = Simulink.Parameter([1.0-1.0i 2.0-2.0i 3.0-3.0i], Complexity="complex")
z = 3.0+4.0i
zRow = [1.0+2.0i 3.0+4.0i 5.0+6.0i]
zThird = 0.33333333333333331+0.1i