% Simulink data dictionary typed_mcos_binary.sldd

pDouble = Simulink.Parameter(3.3)
pDoubleCol = Simulink.Parameter([1; 2; 3])
pDoubleRow = Simulink.Parameter([1.1 2.2 3.3])
pInt16Nd = Simulink.Parameter(int16(reshape([1 2 3 4 5 6 7 8], 2, 2, 2)))
pInt32Col = Simulink.Parameter(int32([100; 200; 300]))
pInt32Row = Simulink.Parameter(int32([100 200 300 400]))
pInt64Min = Simulink.Parameter(int64(-9223372036854775808))
pInt8 = Simulink.Parameter(int8(-42))
pLogical = Simulink.Parameter(true, DataType="boolean")
pLogicalCol = Simulink.Parameter([true; false; true], DataType="boolean")
pLogicalRow = Simulink.Parameter([true false true], DataType="boolean")
pSingle = Simulink.Parameter(single(3.3))
pSingleCol = Simulink.Parameter(single([0.1; 0.2]))
pSingleExact = Simulink.Parameter(single([0.5 16777216]))
pSingleRow = Simulink.Parameter(single([1.1 2.2 3.3]))
pSingleThird = Simulink.Parameter(single(0.333333343))
pUint16Row = Simulink.Parameter(uint16([0 65535]))
pUint64Max = Simulink.Parameter(uint64(18446744073709551615))
pUint8Mat = Simulink.Parameter(uint8([1 2; 3 4]))
sSingle = single(3.3)
sSingleRow = single([1.1 2.2 3.3])
sSingleThird = single(0.333333343)
sSingleTies = single([1000000.12 1000000.38 1000000.62 -1000000.12 2097151.88])