% Simulink data dictionary nd_binary.sldd

c113 = {1; 2; 3}
x113 = reshape([1 2 3], 1, 1, 3)
s113 = "a"
x1113 = reshape([1 2 3], 1, 1, 1, 3)
c122 = {1, 2, 3, 4}
c212 = {1; 2; 3; 4}
x122 = reshape([1 2 3 4], 1, 2, 2)
x212 = reshape([1 2 3 4], 2, 1, 2)
s122 = "a", "b"
st = struct(c113={1; 2; 3}, x113=reshape([1 2 3], 1, 1, 3))
cc = {{1; 2; 3}, 7}