% Simulink data dictionary nd_binary.sldd

c113 = {1; 2; 3}
c122 = {1, 2, 3, 4}
c212 = {1; 2; 3; 4}
cc = {{1; 2; 3}, 7}
st = struct(c113={1; 2; 3}, x113=reshape([1 2 3], 1, 1, 3))
x1113 = reshape([1 2 3], 1, 1, 1, 3)
x113 = reshape([1 2 3], 1, 1, 3)
x122 = reshape([1 2 3 4], 1, 2, 2)
x212 = reshape([1 2 3 4], 2, 1, 2)