% Simulink data dictionary nd_binary.sldd

A = reshape([1 4 2 5 3 6 7 10 8 11 9 12], 2, 3, 2)
C = {1, 2, 3, 4, 5, 6, 7, 8}
Kp = [1 2 3; 4 5 6]
s = [struct(a=1), struct(a=2), struct(a=3), struct(a=4), struct(a=5), struct(a=6), struct(a=7), struct(a=8), struct(a=9), struct(a=10), struct(a=11), struct(a=12)]