% Simulink data dictionary param_paste_binary.sldd

pInt16 = Simulink.Parameter(int16(500))  % an int16
pInt16MinMax = Simulink.Parameter(int16(50), Min=0, Max=100, Unit="m")  % an int16 with a type, a range and a unit
pInt32Vec = Simulink.Parameter(int32([1 2 3 4]))  % an int32 vector
pNested = Simulink.Parameter(struct(m="x", g=struct(p=1, q=0.5, r=0.25)))  % a struct holding a char and a struct of doubles
pPlain = Simulink.Parameter(5)  % a double, which pasted before
pSingle = Simulink.Parameter(single(2.5))  % a single
pStructArr = Simulink.Parameter([struct(a=1, b=[1 2]), struct(a=2, b=[3 4])], DataType="struct")  % a 1x2 struct array
pStructNest = Simulink.Parameter(struct(a=1, b=struct(c=[1 2], d="x")))  % a nested struct
pStructTyped = Simulink.Parameter(struct(k=int8(-5), u=uint16([1 2 3]), f=true, s=single(1.5)))  % a struct of typed fields
pVec = Simulink.Parameter([0 0.1 0.2 0.3 0.4 0.5 0.6 0.7 0.8 0.9 1])  % a 1x11 double vector
sCell = struct(a=1, c={1, "x"})