% Simulink data dictionary shown_saved_binary.sldd

ntAuto = Simulink.NumericType(DataTypeMode="Fixed-point: binary point scaling", WordLength=16, FixedExponent=-4)
ntBp = Simulink.NumericType(DataTypeMode="Fixed-point: binary point scaling", SignednessBool=true, WordLength=16, FixedExponent=-8)
ntSb = Simulink.NumericType(DataTypeMode="Fixed-point: slope and bias scaling", SignednessBool=false, WordLength=8, FixedExponent=-2, SlopeAdjustmentFactor=1.5, Bias=3)
pId = Simulink.Parameter(5, StorageClass="ExportedGlobal", Alias="myId")
sId = Simulink.Signal(StorageClass="ImportedExtern", Alias="ext_x")