% Simulink data dictionary hexobj_binary.sldd

anonAlias = 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
cTall = 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
control = 5
holder = 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
objs = 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
objsCell = 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
pTall = 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