% Simulink data dictionary subclass_defaults_binary.sldd

subAlias = dexsub.Alias(BaseType="double")
subBus = dexsub.Bus()
subNum = dexsub.Num(DataTypeMode="Double", SignednessBool=true, WordLength=64, FixedExponent=0)
subParam = dexsub.Param(Dimensions=[0 0])
subSig = dexsub.Sig()
subVT = dexsub.VT(DataType="double", be=Simulink.BusElement(Name="a", DataType="double"))

vcDefault = Simulink.VariantConfigurations(
  struct(
    Configurations=[],
    VariantConfigurations=[],
    Constraints=[],
    PreferredConfiguration="",
    DefaultConfigurationName="",
    DataDictionaryName="",
    DataDictionarySection="",
    AreSubModelConfigurationsMigrated=true,
    ComponentConfigurationData=[],
    Version="27.1"))