% Simulink data dictionary text_empty_readback_binary.sldd

c_Ch = {[]}
c_Ch20 = {[""; ""]}
c_Ch3 = {[]}
c_D0 = {[]}
c_D10 = {[]}
c_D2 = {[]}
c_D20 = {[]}
c_En0 = {[]}
c_En2 = {[]}
c_I16 = {[]}
c_I8 = {[]}
c_Lg = {[]}
c_Lg0 = {[]}
c_Lg03 = {[]}
c_Params0 = {Simulink.Parameter()}
c_Params00 = {Simulink.Parameter()}
c_Parts0 = {[]}
c_Parts10 = {[]}
e_Ch = []
e_Ch20 = [""; ""]
e_Ch3 = []
e_D0 = []
e_D10 = []
e_D2 = []
e_D20 = []
e_En0 = []
e_En2 = []
e_I16 = []
e_I8 = []
e_Lg = []
e_Lg0 = []
e_Lg03 = []
p_Ch = Simulink.Parameter([], DataType="string")
p_Ch20 = Simulink.Parameter([], DataType="string")
p_Ch3 = Simulink.Parameter([], DataType="string")
p_D0 = Simulink.Parameter([])
p_D10 = Simulink.Parameter([])
p_D2 = Simulink.Parameter([])
p_D20 = Simulink.Parameter([])
p_En0 = Simulink.Parameter([], DataType="Enum: dProbeColors")
p_En2 = Simulink.Parameter([], DataType="Enum: dProbeColors")
p_I16 = Simulink.Parameter([], DataType="int16")
p_I8 = Simulink.Parameter([], DataType="int8")
p_Lg = Simulink.Parameter([], DataType="boolean")
p_Lg0 = Simulink.Parameter([], DataType="boolean")
p_Lg03 = Simulink.Parameter([], DataType="boolean")
s_Ch = struct(f="")
s_Ch20 = struct(f=[""; ""])
s_Ch3 = struct(f="")
s_D0 = struct(f=[])
s_D10 = struct(f=[])
s_D2 = struct(f=[])
s_D20 = struct(f=[])
s_En0 = struct(f=[])
s_En2 = struct(f=[])
s_I16 = struct(f=[])
s_I8 = struct(f=[])
s_Lg = struct(f=[])
s_Lg0 = struct(f=[])
s_Lg03 = struct(f=[])
s_Params0 = struct(f=[])
s_Params00 = struct(f=[])
s_Parts0 = struct(f=[])
s_Parts10 = struct(f=[])

w_Ch = Widget(
  Matrix=0,
  Cplx=0,
  Padded=0,
  Str=0,
  Flag=0,
  Nothing=0,
  EmptyStruct=0,
  ZeroStruct=0,
  Nested=0,
  Cells=0,
  Hostile=0,
  Ctrl=0,
  Cr=0,
  Tab=0,
  Lf=0,
  Mode=0,
  Part=0,
  Parts=0,
  Tuning=0)

w_Ch20 = Widget(
  Scalar=[""; ""],
  Matrix=0,
  Cplx=0,
  Padded=0,
  Str=0,
  Flag=0,
  Nothing=0,
  EmptyStruct=0,
  ZeroStruct=0,
  Nested=0,
  Cells=0,
  Hostile=0,
  Ctrl=0,
  Cr=0,
  Tab=0,
  Lf=0,
  Mode=0,
  Part=0,
  Parts=0,
  Tuning=0)

w_Ch3 = Widget(
  Matrix=0,
  Cplx=0,
  Padded=0,
  Str=0,
  Flag=0,
  Nothing=0,
  EmptyStruct=0,
  ZeroStruct=0,
  Nested=0,
  Cells=0,
  Hostile=0,
  Ctrl=0,
  Cr=0,
  Tab=0,
  Lf=0,
  Mode=0,
  Part=0,
  Parts=0,
  Tuning=0)

w_D0 = Widget(
  Matrix=0,
  Cplx=0,
  Padded=0,
  Str=0,
  Flag=0,
  Nothing=0,
  EmptyStruct=0,
  ZeroStruct=0,
  Nested=0,
  Cells=0,
  Hostile=0,
  Ctrl=0,
  Cr=0,
  Tab=0,
  Lf=0,
  Mode=0,
  Part=0,
  Parts=0,
  Tuning=0)

w_D10 = Widget(
  Matrix=0,
  Cplx=0,
  Padded=0,
  Str=0,
  Flag=0,
  Nothing=0,
  EmptyStruct=0,
  ZeroStruct=0,
  Nested=0,
  Cells=0,
  Hostile=0,
  Ctrl=0,
  Cr=0,
  Tab=0,
  Lf=0,
  Mode=0,
  Part=0,
  Parts=0,
  Tuning=0)

w_D2 = Widget(
  Matrix=0,
  Cplx=0,
  Padded=0,
  Str=0,
  Flag=0,
  Nothing=0,
  EmptyStruct=0,
  ZeroStruct=0,
  Nested=0,
  Cells=0,
  Hostile=0,
  Ctrl=0,
  Cr=0,
  Tab=0,
  Lf=0,
  Mode=0,
  Part=0,
  Parts=0,
  Tuning=0)

w_D20 = Widget(
  Matrix=0,
  Cplx=0,
  Padded=0,
  Str=0,
  Flag=0,
  Nothing=0,
  EmptyStruct=0,
  ZeroStruct=0,
  Nested=0,
  Cells=0,
  Hostile=0,
  Ctrl=0,
  Cr=0,
  Tab=0,
  Lf=0,
  Mode=0,
  Part=0,
  Parts=0,
  Tuning=0)

w_En0 = Widget(
  Matrix=0,
  Cplx=0,
  Padded=0,
  Str=0,
  Flag=0,
  Nothing=0,
  EmptyStruct=0,
  ZeroStruct=0,
  Nested=0,
  Cells=0,
  Hostile=0,
  Ctrl=0,
  Cr=0,
  Tab=0,
  Lf=0,
  Mode=0,
  Part=0,
  Parts=0,
  Tuning=0)

w_En2 = Widget(
  Matrix=0,
  Cplx=0,
  Padded=0,
  Str=0,
  Flag=0,
  Nothing=0,
  EmptyStruct=0,
  ZeroStruct=0,
  Nested=0,
  Cells=0,
  Hostile=0,
  Ctrl=0,
  Cr=0,
  Tab=0,
  Lf=0,
  Mode=0,
  Part=0,
  Parts=0,
  Tuning=0)

w_I16 = Widget(
  Matrix=0,
  Cplx=0,
  Padded=0,
  Str=0,
  Flag=0,
  Nothing=0,
  EmptyStruct=0,
  ZeroStruct=0,
  Nested=0,
  Cells=0,
  Hostile=0,
  Ctrl=0,
  Cr=0,
  Tab=0,
  Lf=0,
  Mode=0,
  Part=0,
  Parts=0,
  Tuning=0)

w_I8 = Widget(
  Matrix=0,
  Cplx=0,
  Padded=0,
  Str=0,
  Flag=0,
  Nothing=0,
  EmptyStruct=0,
  ZeroStruct=0,
  Nested=0,
  Cells=0,
  Hostile=0,
  Ctrl=0,
  Cr=0,
  Tab=0,
  Lf=0,
  Mode=0,
  Part=0,
  Parts=0,
  Tuning=0)

w_Lg = Widget(
  Matrix=0,
  Cplx=0,
  Padded=0,
  Str=0,
  Flag=0,
  Nothing=0,
  EmptyStruct=0,
  ZeroStruct=0,
  Nested=0,
  Cells=0,
  Hostile=0,
  Ctrl=0,
  Cr=0,
  Tab=0,
  Lf=0,
  Mode=0,
  Part=0,
  Parts=0,
  Tuning=0)

w_Lg0 = Widget(
  Matrix=0,
  Cplx=0,
  Padded=0,
  Str=0,
  Flag=0,
  Nothing=0,
  EmptyStruct=0,
  ZeroStruct=0,
  Nested=0,
  Cells=0,
  Hostile=0,
  Ctrl=0,
  Cr=0,
  Tab=0,
  Lf=0,
  Mode=0,
  Part=0,
  Parts=0,
  Tuning=0)

w_Lg03 = Widget(
  Matrix=0,
  Cplx=0,
  Padded=0,
  Str=0,
  Flag=0,
  Nothing=0,
  EmptyStruct=0,
  ZeroStruct=0,
  Nested=0,
  Cells=0,
  Hostile=0,
  Ctrl=0,
  Cr=0,
  Tab=0,
  Lf=0,
  Mode=0,
  Part=0,
  Parts=0,
  Tuning=0)

w_Params0 = Widget(
  Matrix=0,
  Cplx=0,
  Padded=0,
  Str=0,
  Flag=0,
  Nothing=0,
  EmptyStruct=0,
  ZeroStruct=0,
  Nested=0,
  Cells=0,
  Hostile=0,
  Ctrl=0,
  Cr=0,
  Tab=0,
  Lf=0,
  Mode=0,
  Part=0,
  Parts=0,
  Tuning=0)

w_Params00 = Widget(
  Matrix=0,
  Cplx=0,
  Padded=0,
  Str=0,
  Flag=0,
  Nothing=0,
  EmptyStruct=0,
  ZeroStruct=0,
  Nested=0,
  Cells=0,
  Hostile=0,
  Ctrl=0,
  Cr=0,
  Tab=0,
  Lf=0,
  Mode=0,
  Part=0,
  Parts=0,
  Tuning=0)

w_Parts0 = Widget(
  Matrix=0,
  Cplx=0,
  Padded=0,
  Str=0,
  Flag=0,
  Nothing=0,
  EmptyStruct=0,
  ZeroStruct=0,
  Nested=0,
  Cells=0,
  Hostile=0,
  Ctrl=0,
  Cr=0,
  Tab=0,
  Lf=0,
  Mode=0,
  Part=0,
  Parts=0,
  Tuning=0)

w_Parts10 = Widget(
  Matrix=0,
  Cplx=0,
  Padded=0,
  Str=0,
  Flag=0,
  Nothing=0,
  EmptyStruct=0,
  ZeroStruct=0,
  Nested=0,
  Cells=0,
  Hostile=0,
  Ctrl=0,
  Cr=0,
  Tab=0,
  Lf=0,
  Mode=0,
  Part=0,
  Parts=0,
  Tuning=0)