% Simulink data dictionary typed_binary.sldd

cTyped = {{int32([1 2]), single(1.5), true, ["ab"; "cd"]}}
i32Col = int32([1; 2; 3])
i32Mat = int32([1 2; 3 4])
i32Vec = int32([1 2 3])
lglVec = [true false true]
sCharMat = struct(m=["ace"; "bdf"], r="row")
sTyped = struct(a=int32([1 2]), b=single(3.5), c=true, d=uint64([7 8]))
sglVec = single([1.5 2.5])
u64Vec2 = uint64([1 2])