% Simulink data dictionary battery_binary.sldd

battery_d = [3.111324e+180 -5.842921e-48 -5.521423e+68 -8.839135e+59 2.820649e-184 -1.516307e-124 5.40262e+23 -2.431002e-241 -3.320321e-161 1.671773e+85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 2.470328e-322]
battery_s = single([6.30703596e-8 5.86298944e+31 1.61264074e+29 2.49437856e-31 -8.083154e+24 -1.16701093e-10 2.30811936e+36 -2.64069e-7 4.94888811e-31 1.3283826e-24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 5.60519e-44])
edge_c = [1.0E-7+2.0E-8i 1000000.0-0.0i -0.0+1.0i 3.1415926535897931-0.33333333333333331i 1.0E+15+1.0E+16i 9007199254740992.0-4.94065645841247E-324i]
edge_cs = single([1.0E-7+2.0E-8i 1.0E+6-0.0i -0.0+1.0i 3.14159274-0.333333343i 1.0E+6+1.0E+7i])
edge_d = [0 -0 Inf -Inf NaN 1 -1.5 0.1 0.3333333 3.141593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 1.482197e-323]
edge_p = Simulink.Parameter(1.0e-5, Min=-0, Max=1000000)
edge_s = single([0 -0 Inf -Inf NaN 1 -1.5 0.1 0.333333343 3.14159274 1.1920929e-7 1.0e-5 0.0001 0.00015 100000 1.0e+6 1.0e+7 16777216 16777218 123456792 1000000.12 3.4e+38 1.4013e-45 0.3 3.402823466e+38 -3.402823466e+38 1.17549435e-38 5.87747175e-39])