% Simulink data dictionary negzero_binary.sldd

negz = -0
negzCell = {-0}
negzCol = [-0; 1]
negzInfRow = [-0 Inf]
negzMat = [-0 1; 2 3]
negzP = Simulink.Parameter(-0)
negzRow = [-0 1]
negzS = single(-0)
negzSCell = {single(-0)}
negzSCol = single([-0; 1])
negzSRow = single([-0 1])
negzStruct = struct(a=-0)
posz = 0
poszS = single(0)