% Simulink data dictionary pre69664b0_old_saves_r2027a_binary.sldd

sE00 = []
sE002 = []
sE02 = []
sE10ab = []
sE20 = []
sHolds = struct(x=1, e=[], none=[])
csAutosar = Simulink.ConfigSet(StartTime="0", StopTime="10", RelTol="1e-3", Solver="VariableStepAuto", ProdHWDeviceType="Intel->x86-64 (Windows64)", SystemTargetFile="autosar.tlc", TargetLang="C")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
csSimscape = Simulink.ConfigSet(StartTime="0", StopTime="10", RelTol="1e-3", Solver="VariableStepAuto", ProdHWDeviceType="Intel->x86-64 (Windows64)", SystemTargetFile="grt.tlc", TargetLang="C")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
holdsBase = NdHolder(Kids=[Simulink.Signal(), dexdata.DerivedSignal(Routing="bus", Priority=int32(5))], Tag="base")
holdsMixed = NdHolder(Kids=[dexdata.DerivedSignal(Routing="bus", Priority=int32(5)), Simulink.Signal()], Tag="mixed")