% Simulink data dictionary pre90caf06_cases.sldd

aBus = Simulink.Bus()  % a bus
  x: double[3]
  y: int8

aLookup = Simulink.LookupTable(
  Table=Simulink.lookuptable.Table(Dimensions=[0 0], FieldName="Table"),
  BreakpointsSpecification="Explicit values",
  Breakpoints=Simulink.lookuptable.Breakpoint(TunableSizeName="N1", TunableSizeValue=-1, Dimensions=[0 0], FieldName="BP1"),
  AllowMultipleInstancesOfTypeToHaveDifferentTableBreakpointSizes=false)

aParam = Simulink.Parameter(5, DataType="int16", Min=-10, Max=10, Unit="m/s")  % a param
aSignal = Simulink.Signal(DataType="single", Min=0, Max=100, Unit="K")  % a signal

aVariant = Simulink.VariantVariable(
  struct(
    Choices=[struct(Condition="V == 1", Value=1), struct(Condition="V == 2", Value=2)],
    Specification=[],
    Bank=[]))

bigD = 1e+300
boolF = false
boolT = true
boolVec = [true false true]

cell2x3 = {1, 2, 3
 4, 5, 6}

cellEmpty = []
cellFlat = {1, "two", [3 4]}
cellNd = {1, 2, 3, 4, 5, 6, 7, 8, 9, 10, 11, 12}
cellNest = {1, {2, {3}}}
charStr = "it's"
colVec = [1; 2; 3]
cplxScalar = 3.0+4.0i
cplxVec = [1.0+2.0i 3.0-4.0i]
eleven = [1 2 3 4 5 6 7 8 9 10 11]
emptyD = []
exactly10 = [1 2 3 4 5 6 7 8 9 10]
hugeChar = "yyyyyyyyyyyyyyyyyyyyyyyyyyyyyyyyyyyyyyyyyyyyyyyyyyyyyyyyyyyy"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
i16Vec = int16([1 2 3])
i64Unsafe = int64(9007199254740993)
i64Vec = int64([9223372036854775807 -9223372036854775808 -1])
infN = -Inf
infP = Inf
kp = 1.5
long30 = [1 2 3 4 5 6 7 8 9 10 11 12 13 14 15 16 17 18 19 20 21 22 23 24 25 26 27 28 29 30]
longChar = "xxxxxxxxxxxxxxxxxxxxxxxxxxxxxxxxxxxxxxxxxxxxxxxxxxxxxxxxxxxx"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
mat2x3 = [1 2 3; 4 5 6]
maxU64 = uint64(18446744073709551615)
max_int16 = int16(32767)
max_int32 = int32(2147483647)
max_int64 = int64(9223372036854775807)
max_int8 = int8(127)
max_uint16 = uint16(65535)
max_uint32 = uint32(4294967295)
max_uint8 = uint8(255)
min_int16 = int16(-32768)
min_int32 = int32(-2147483648)
min_int64 = int64(-9223372036854775808)
min_int8 = int8(-128)
min_uint16 = uint16(0)
min_uint32 = uint32(0)
min_uint64 = uint64(0)
min_uint8 = uint8(0)
nanV = NaN
nd2x3x2 = reshape([1 4 2 5 3 6 7 10 8 11 9 12], 2, 3, 2)
negD = -2.5
nonFinVec = [1 Inf -Inf NaN 5]
rowVec = [1 2 3]
s_int16 = int16(7)
s_int32 = int32(7)
s_int64 = int64(7)
s_int8 = int8(7)
s_uint16 = uint16(7)
s_uint32 = uint32(7)
s_uint64 = uint64(7)
s_uint8 = uint8(7)
scalarD = 3.141593
scalarS = single(3.14159274)
strArray = "a", "bb", "ccc"

strMat = "a", "bb", "ccc"
 "d", "ee", "fff"

strScalar = "world"
struct1x3 = [struct(a=1, b=10), struct(a=2, b=20), struct(a=3, b=30)]
struct2x3 = [struct(a=1), struct(a=2), struct(a=3), struct(a=4), struct(a=5), struct(a=6)]
structEmpty = []
structNd = [struct(a=1), struct(a=2), struct(a=3), struct(a=4), struct(a=5), struct(a=6), struct(a=7), struct(a=8), struct(a=9), struct(a=10), struct(a=11), struct(a=12)]
structNest = struct(a=struct(b=2))
structScalar = struct(a=1, b="txt")
tinyD = 1e-300
u64Vec = uint64([18446744073709551615 1 0])